# Grasshopper definition Basic_Outdoor_Comfort.gh (Grasshopper 0.9.76)
# plug-ins: Python Interpreter

# Street Canyon W/H Ratio
height_to_width_ratio = Slider(1, range=0.3..2)

# ----
# Building Dimensions
honeybee = Honeybee_Honeybee()  # -> Vviiiiiiiiiizzz; plug-in component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
ladybug = Ladybug_Ladybug()  # -> Vviiiiiiiiiizzz; plug-in component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

# ----
# Analysis Grid Size
number_slider = Slider(3, range=1..5)
flr_height = Panel("@3.2")
height = Panel("12")
y_dim = Panel("10")
x_dim = Panel("30")
tree_height = Panel("3.5")
crownsize = Panel("1.5")
# Street Tree Dimensions
distbetween = Panel("5")
geo = Geometry(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)
Z = UnitZ(Factor=tree_height)
tall_buildings = Geometry([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])
pt = Point(Point(1588977.881, 6803927.066, 0))  # disabled
small_buildings = Geometry([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])
number_slider_2 = Slider(-3, range=-3..0)
move = Move(Geometry=pt, Motion=Z)  # -> Geometry, Transform
boundary = BoundarySurfaces(Edges=[tall_buildings, geo])
Z_2 = UnitZ(Factor=Slider(30, range=0..100))
Z_3 = UnitZ(Factor=Slider(14, range=0..100))
boundary_2 = BoundarySurfaces(Edges=small_buildings)
Z_4 = UnitZ(Factor=number_slider_2)
box = CenterBox(Base=move.Geometry, X=crownsize, Y=crownsize, Z=1)
extr = Extrude(Base=boundary, Direction=Z_2)
geo_2 = Geometry(<curve referenced from the Rhino model>)
extr_2 = Extrude(Base=boundary_2, Direction=Z_3)
merge = Merge(Data1=boundary, Data2=boundary_2)
multiplication = Multiplication(A=number_slider_2, B=Slider(-2, range=-2..0))
boundary_3 = BoundarySurfaces(Edges=geo_2)
move_2 = Move(Geometry=merge, Motion=Z_4)  # -> Geometry, Transform
Z_5 = UnitZ(Factor=multiplication)
extr_3 = Extrude(Base=move_2.Geometry, Direction=Z_5)
# Create Building Geometry
merge_2 = Merge(Data1=extr, Data2=extr_2)
# Create Street Trees
number_slider_3 = Slider(-5, range=-5..0)
pipeline = GeometryPipeline(
    GroupByLayer=False,
    GroupByType=False,
    IncludeHidden=True,
    IncludeLocked=True,
    LayerFilter="buildings",
    NameFilter="*",
    TypeFilter=1073741848)
# Create Context Building Geometry
pipeline_2 = GeometryPipeline(
    GroupByLayer=False,
    GroupByType=False,
    IncludeHidden=True,
    IncludeLocked=True,
    LayerFilter="shadowing buildings",
    NameFilter="*",
    TypeFilter=1073741848)
pipeline_3 = GeometryPipeline(
    GroupByLayer=False,
    GroupByType=False,
    IncludeHidden=True,
    IncludeLocked=True,
    LayerFilter="project buildings",
    NameFilter="*",
    TypeFilter=1073741848)
# Create Ground Geometry
trim = TrimSolid(Shape=boundary_3, Cutters=extr_3)
Z_6 = UnitZ(Factor=number_slider_3)
rev = ReverseList(List=pipeline_3)
panel = Panel("https://www.energyplus.net/weather-download/europe_wmo_region_6/ESP//ESP_Malaga.084820_SWEC/all")
brep = Brep(boundary_3)
split = SplitList(List=rev, Index=Slider(1, range=-1..1))  # -> ListA, ListB
merge_3 = Merge(Data1=pipeline_2, Data2=pipeline, Data3=pipeline_3)
flip = Flip(Surface=brep)  # -> Surface, Result
merge_4 = Merge(Data1=pipeline, Data2=pipeline_2, Data3=split.ListB)  # -> flatten(Result)
move_3 = Move(Geometry=merge_4, Motion=Z_6)  # -> Geometry, Transform
hour = Slider(11, range=8..20)
number_slider_4 = Slider(6, range=1..12)
number_slider_5 = Slider(21, range=1..31)
geo_3 = Geometry(split.ListA)
bbx = BrepBrep(BrepA=geo_3, BrepB=move_3.Geometry)  # -> flatten(Curves), Points
epw_stat = Ladybug_OpenEPWAndSTATWeatherFiles(weatherFileURL=panel)  # -> epwFile, statFile; plug-in component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
python = PythonScript(day=number_slider_5, month=number_slider_4, hour=hour)  # -> out, a
# ---------- python: Python ----------
def add_zeroes(day):
    day = int(day)
    if day <10:
        day = '0{}'.format(day)
    return str(day)
 
a = '{}-{}-2018 {}:00'.format(add_zeroes(day), add_zeroes(month), add_zeroes(hour))
# ---------- end python ----------
explode = Explode(Curve=bbx.Curves, Recursive=True)  # -> flatten(Segments), Vertices
doy_hoy = Ladybug_DOY_HOY(days=number_slider_5, months=number_slider_4, hours=hour)  # -> HOY, DOY, date; plug-in component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
panel_2 = Panel(python.a)
gencumulativeskymtx = Ladybug_GenCumulativeSkyMtx(epwFile=epw_stat.epwFile, skyDensity=0, useOldRes=True, runIt=Toggle(True))  # -> readMe, cumulativeSkyMtx; plug-in component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
panel_3 = Panel(doy_hoy.date)
fly = Ladybug_fly(inputSliders=[number_slider_4, hour], fly=Toggle(False))  # -> Vviiiiiiiiiizzz; plug-in component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
selectskymtx = Ladybug_selectSkyMtx(cumulativeSkyMtx=gencumulativeskymtx.cumulativeSkyMtx, HOY=doy_hoy.HOY, removeDiffuse=False, removeDirect=False)  # -> readMe, selectedSkyMtx; plug-in component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
radiationanalysis = Ladybug_RadiationAnalysis(
    geometry=flatten(flip.Surface),
    context=flatten(merge_3),
    gridSize=Slider(3, range=0..10),
    disFromBase=Slider(0.6, range=0..1),
    selectedSkyMtx=flatten(selectskymtx.selectedSkyMtx),
    runIt=Toggle(True))  # -> readMe, contextMesh, analysisMesh, testPts, testVec, port, radiationResult, radiationMesh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; plug-in component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
python_2 = PythonScript(data=radiationanalysis.radiationResult, date=python.a)  # -> out, a; inputs data: list
# ---------- python_2: Python ----------
fp = 'data\\radiation.txt'

data = [str(datum) for datum in data]
print(data)
data.append(date)
#print(data)

print(data)
with open(fp, 'a') as f:
    f.write(','.join(data)+'\n')
# ---------- end python_2 ----------
recolormesh = Ladybug_RecolorMesh(analysisResult=radiationanalysis.radiationResult, inputMesh=radiationanalysis.radiationMesh)  # -> readMe, newMesh, newLegend, legendBasePt, meshColors, legendColors; disabled; plug-in component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
panel_4 = Panel(radiationanalysis.radiationResult)
# Build Outdoor Microclimate Map
outdoorcomfortcalculator = Ladybug_OutdoorComfortCalculator()  # -> readMe, port, universalThermalClimateIndex, comfortableOrNot, thermalStress, conditionOfPerson, port_2, percentOfTimeComfortable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; plug-in component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
