# Grasshopper definition Outdoor_Microclimate_Map.gh (Grasshopper 0.9.76)
# plug-ins: Python Interpreter

# Street Canyon W/H Ratio
height_to_width_ratio = Slider(1, range=0.3..2)

# ----
# Building Dimensions
honeybee = Honeybee_Honeybee()  # -> Vviiiiiiiiiizzz; plug-in component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
ladybug = Ladybug_Ladybug()  # -> Vviiiiiiiiiizzz; plug-in component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

# ----
# Analysis Grid Size
number_slider = Slider(3, range=1..5)
flr_height = Panel("@3.2")
height = Panel("12")
y_dim = Panel("10")
x_dim = Panel("30")
tree_height = Panel("3.5")
crownsize = Panel("1.5")
# Street Tree Dimensions
distbetween = Panel("5")
geo = Geometry(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)
Z = UnitZ(Factor=tree_height)
tall_buildings = Geometry([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])
pt = Point(Point(1588977.881, 6803927.066, 0))  # disabled
small_buildings = Geometry([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])
number_slider_2 = Slider(-3, range=-3..0)
move = Move(Geometry=pt, Motion=Z)  # -> Geometry, Transform
boundary = BoundarySurfaces(Edges=[tall_buildings, geo])
Z_2 = UnitZ(Factor=Slider(30, range=0..100))
Z_3 = UnitZ(Factor=Slider(14, range=0..100))
boundary_2 = BoundarySurfaces(Edges=small_buildings)
Z_4 = UnitZ(Factor=number_slider_2)
# Create Street Trees
box = CenterBox(Base=move.Geometry, X=crownsize, Y=crownsize, Z=1)
extr = Extrude(Base=boundary, Direction=Z_2)
geo_2 = Geometry(<curve referenced from the Rhino model>)
extr_2 = Extrude(Base=boundary_2, Direction=Z_3)
merge = Merge(Data1=boundary, Data2=boundary_2)
multiplication = Multiplication(A=number_slider_2, B=Slider(-2, range=-2..0))
boundary_3 = BoundarySurfaces(Edges=geo_2)
move_2 = Move(Geometry=merge, Motion=Z_4)  # -> Geometry, Transform
Z_5 = UnitZ(Factor=multiplication)
extr_3 = Extrude(Base=move_2.Geometry, Direction=Z_5)
# Create Building Geometry
merge_2 = Merge(Data1=extr, Data2=extr_2)
# Create Ground Geometry
trim = TrimSolid(Shape=boundary_3, Cutters=extr_3)

brep = Brep(trim)
gentestpts = Honeybee_GenerateTestPoints(testGeometry=brep, gridSize=number_slider, distBaseSrf="0", moveTestMesh=Toggle(False))  # -> readMe, simplify(testPoints), simplify(ptsVectors), simplify(facesArea), simplify(mesh); plug-in component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
faceb = FaceBoundaries(Mesh=gentestpts.mesh)
brep_2 = Brep(faceb)
join = BrepJoin(Breps=flatten(brep_2))  # -> Breps, Closed; disabled

pipeline = GeometryPipeline(
    GroupByLayer=False,
    GroupByType=False,
    IncludeHidden=True,
    IncludeLocked=True,
    LayerFilter="buildings",
    NameFilter="*",
    TypeFilter=0)
# Create Context Building Geometry
pipeline_2 = GeometryPipeline(
    GroupByLayer=False,
    GroupByType=False,
    IncludeHidden=True,
    IncludeLocked=True,
    LayerFilter="shadowing buildings",
    NameFilter="*",
    TypeFilter=1073741848)
bldgprograms = Honeybee_bldgPrograms({"Office": 0, "Retail": 1, "MidriseApartment": 2, "PrimarySchool": 3, "SecondarySchool": 4, "SmallHotel": 5, "LargeHotel": 6, "Hospital": 7, "Outpatient": 8, "Warehouse": 9, "SuperMarket": 10, "FullServiceRestaurant": 11, "QuickServiceRestaurant": 12}, selected="MidriseApartment")
split2floors = Honeybee_SplitBuildingMass2Floors(bldgMasses=merge_2, bldgsFlr2FlrHeights=flr_height, runIt=Toggle(True))  # -> readMe, flatten(splitBldgFloors); plug-in component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
pt_2 = ConstructPoint(XCoordinate=0, YCoordinate=0, ZCoordinate=1)
listzoneprograms = Honeybee_ListZonePrograms(bldgProgram=bldgprograms)  # -> MidriseApartmentZonePrograms; plug-in component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
move_3 = Move(Geometry=brep, Motion=pt_2)  # -> Geometry, Transform
toggle = BooleanToggle(True)
Z_6 = UnitZ(Factor=Slider(-2, range=-2..0))
extr_4 = Extrude(Base=brep, Direction=Z_6)
item = ListItem(List=listzoneprograms, Index=0, Wrap=True)

brep_3 = Brep(brep)
# Set Up a Zone for the Ground
mass2zone = Honeybee_Masses2Zones(
    zoneMasses=flatten(brep_3),
    zoneNames="GroundZone",
    isConditioned=Toggle(False),
    maxRoofAngle=30,
    createHBZones=Toggle(True))  # -> readMe, HBZones; plug-in component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
createepground = Honeybee_CreateEPGround(HBZones=mass2zone.HBZones, soilTypeOrMat="4")  # -> HBGrndZones; plug-in component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

merge_3 = Merge(Data1=pipeline_2, Data2=pipeline)
debrep = DeconstructBrep(Brep=merge_3)  # -> flatten(Faces), Edges, Vertices

# ----
# Specify Simulation Parameters
panel = Panel("https://www.energyplus.net/weather-download/europe_wmo_region_6/ESP//ESP_Malaga.084820_SWEC/all")
epoutput = Honeybee_GenerateEPOutput(zoneGainsAndLosses="False", zoneComfortMetrics="False", surfaceTempAnalysis=Toggle(True))  # -> report, flatten(simulationOutputs); plug-in component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
analysisperiod = Ladybug_AnalysisPeriod(fromMonth="8", toMonth="8")  # -> readMe, analysisPeriod; plug-in component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
epw_stat = Ladybug_OpenEPWAndSTATWeatherFiles(weatherFileURL=panel)  # -> epwFile, statFile; plug-in component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

# ----
# Account for Context Like Trees and Other Bldgs
brep_4 = Brep(debrep.Faces)
brep_5 = Brep(box)
hb_epcontextsrf = HoneybeeEPContextSurfaces(shdSurfaces=flatten(brep_5))  # -> HBContext; inputs shdSurfaces: list of GeometryBase, justBoundingBox: Boolean
# ---------- hb_epcontextsrf: Python ----------
"""
prepare shading/context geometries

    Args:
        northVectorOrRotation: A vector that shows North or a number that shows
                               the rotation of the North from the Y axis
        bldgMasses: List of closed Breps as thermal zones.
    Returns:
        report: ...
        thermalZones: Thermal zone's geometries for visualiza
"""

ghenv.Component.Name = 'Honeybee EP context Surfaces'
ghenv.Component.NickName = 'HB_EPContextSrf'
ghenv.Component.Message = 'VER 0.0.61\nFEB_05_2017'
ghenv.Component.IconDisplayMode = ghenv.Component.IconDisplayMode.application
ghenv.Component.Category = "Honeybee"
ghenv.Component.SubCategory = "10 | Energy | Energy"
#compatibleHBVersion = VER 0.0.57\nNOV_04_2016
#compatibleLBVersion = VER 0.0.59\nFEB_01_2015
ghenv.Component.AdditionalHelpFromDocStrings = "2"

import rhinoscriptsyntax as rs
import Rhino as rc
import scriptcontext as sc
import os
import System
import Grasshopper.Kernel as gh
import uuid

tolerance = sc.doc.ModelAbsoluteTolerance
import math


def main(shdSurfaces, EPTransSchedule, meshingSettings, justBoundingBox):
    
    # import the classes
    if sc.sticky.has_key('honeybee_release'):

        try:
            if not sc.sticky['honeybee_release'].isCompatible(ghenv.Component): return -1
            if sc.sticky['honeybee_release'].isInputMissing(ghenv.Component): return -1
        except:
            warning = "You need a newer version of Honeybee to use this compoent." + \
            " Use updateHoneybee component to update userObjects.\n" + \
            "If you have already updated userObjects drag Honeybee_Honeybee component " + \
            "into canvas and try again."
            w = gh.GH_RuntimeMessageLevel.Warning
            ghenv.Component.AddRuntimeMessage(w, warning)
            return -1
        
        # don't customize this part
        hb_EPSrf = sc.sticky["honeybee_EPSurface"]
        hb_EPSHDSurface = sc.sticky["honeybee_EPShdSurface"]
        hb_RADMaterialAUX = sc.sticky["honeybee_RADMaterialAUX"]
        hb_EPObjectsAux = sc.sticky["honeybee_EPObjectsAUX"]()
        HBScheduleList = sc.sticky["honeybee_ScheduleLib"].keys()

        ########################################################################
        #----------------------------------------------------------------------#
        shdBreps = []
        # create bounding box of shading geometries
        if justBoundingBox:
            for brep in shdSurfaces:
                if brep.Faces.Count>1 or not brep.Faces[0].IsPlanar(sc.doc.ModelAbsoluteTolerance):
                    shdBreps.append(brep.GetBoundingBox(True).ToBrep())
                else:
                    shdBreps.append(brep)
        else:
            shdBreps = shdSurfaces
        
        shadingClasses = []
        shadingMeshPreview = []
        
        if meshingSettings == None:
            mp = rc.Geometry.MeshingParameters.Minimal
            mp.SimplePlanes = True
        else:
            mp = meshingSettings
        
        def getRadMaterialName(radMaterial):
            nameStr = radMaterial.split(" ")[2]
            name =  nameStr.split("\n")[0]
            return name
        
        for brepCount, brep in enumerate(shdBreps):
            if brep != None:
                isPlanar = True
                # check planarity
                for face in brep.Faces:
                    if not face.IsPlanar(tolerance):
                        isPlanar = False
                        break
                
                shadingBreps = []
                if not isPlanar:
                    meshArray = rc.Geometry.Mesh.CreateFromBrep(brep, mp)
                    for mesh in meshArray:
                        for meshFace in range(mesh.Faces.Count):
                            vertices = list(mesh.Faces.GetFaceVertices(meshFace))[1:]
                            vertices = vertices + [sc.doc.ModelAbsoluteTolerance]
                            # create the brep from mesh
                            shdBrep = rc.Geometry.Brep.CreateFromCornerPoints(*vertices)
                            shadingBreps.append(shdBrep)
                else:
                    for face in brep.Faces:
                        shadingBreps.append(face.DuplicateFace(False))
                
                for faceCount, shdBrep in enumerate(shadingBreps):
                        thisShading = hb_EPSHDSurface(shdBrep, 1000*brepCount + faceCount, 'shdSrf_' + `brepCount` + '_' + `faceCount` + "_" + str(uuid.uuid4()))
                        
                        # add transmittance schedule if any
                        if EPTransSchedule!=None:
                            schedule= EPTransSchedule.upper()
                            if schedule!=None and not schedule.lower().endswith(".csv") and schedule not in HBScheduleList:
                                msg = "Cannot find " + schedule + " in Honeybee schedule library."
                                print msg
                                ghenv.Component.AddRuntimeMessage(gh.GH_RuntimeMessageLevel.Warning, msg)
                                return -1
                            elif schedule!=None and schedule.lower().endswith(".csv"):
                                # check if csv file is existed
                                if not os.path.isfile(schedule):
                                    msg = "Cannot find the shchedule file: " + schedule
                                    print msg
                                    ghenv.Component.AddRuntimeMessage(gh.GH_RuntimeMessageLevel.Warning, msg)
                                    return -1
                            
                            thisShading.TransmittanceSCH = schedule
                        
                        # add the Rad Material if any
                        if RADMaterial!=None:
                            # if it is just the name of the material make sure it is already defined
                            if len(RADMaterial.split(" ")) == 1:
                                # if the material is not in the library add it to the library
                                if not hb_RADMaterialAUX.isMatrialExistInLibrary(RADMaterial):
                                    warningMsg = "Can't find " + RADMaterial + " in RAD Material Library.\n" + \
                                                "Add the material to the library and try again."
                                    ghenv.Component.AddRuntimeMessage(gh.GH_RuntimeMessageLevel.Warning, warningMsg)
                                    return
                                
                                try:
                                    thisShading.setRADMaterial(RADMaterial)
                                except Exception, e:
                                    print e
                                    warningMsg = "You are using an old version of Honeybee_Honeybee! Update your files and try again."
                                    print warningMsg
                                    ghenv.Component.AddRuntimeMessage(gh.GH_RuntimeMessageLevel.Warning, warningMsg)
                                    return
                                
                                addedToLib = True
                            else:
                                
                                # try to add the material to the library
                                addedToLib, thisShading.RadMaterial = hb_RADMaterialAUX.analyseRadMaterials(RADMaterial, True)
                                
                            if addedToLib==False:
                                warningMsg = "Failed to add " + RADMaterial + " to the Library."
                                ghenv.Component.AddRuntimeMessage(gh.GH_RuntimeMessageLevel.Warning, warningMsg)
                                return
                        
                        # add shading to the list
                        shadingClasses.append(thisShading)
                
        # add to the hive
        hb_hive = sc.sticky["honeybee_Hive"]()
        HBContext  = hb_hive.addToHoneybeeHive(shadingClasses, ghenv.Component)
        return HBContext
        ################################################################################################
    else:
        print "You should first let Honeybee to fly..."
        w = gh.GH_RuntimeMessageLevel.Warning
        ghenv.Component.AddRuntimeMessage(w, "You should first let Honeybee to fly...")
        return -1
        

if _shdSurfaces and _shdSurfaces[0]!=None:
    # add cleaning function
    result= main(_shdSurfaces, EPTransSchedule_, meshingSettings_, justBoundingBox_)
    
    if result != -1: HBContext = result
# ---------- end hb_epcontextsrf ----------
hb_epcontextsrf_2 = HoneybeeEPContextSurfaces(shdSurfaces=flatten(brep_4))  # -> HBContext; inputs shdSurfaces: list of GeometryBase, justBoundingBox: Boolean; same code as hb_epcontextsrf

merge_4 = Merge(Data1=hb_epcontextsrf_2, Data2=hb_epcontextsrf)  # -> flatten(Result)
null = NullItem(Item=merge_4)  # -> NullFlags, InvalidFlags, Description
bool = Boolean(invert(null.NullFlags))
cull = CullPattern(List=merge_4, CullPattern=bool)  # disabled

number_slider_3 = Slider(4, range=1..23)
addition = Addition(A=number_slider_3, B=1)
analysisperiod_2 = Ladybug_AnalysisPeriod(fromMonth="8", fromHour=number_slider_3, toMonth="8", toHour=addition)  # -> readMe, analysisPeriod; plug-in component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

brep_6 = Brep(split2floors.splitBldgFloors)
mass2zone_2 = Honeybee_Masses2Zones(zoneMasses=flatten(brep_6), zonePrograms=item, isConditioned=Toggle(True), maxRoofAngle=30, createHBZones=Toggle(True))  # -> readMe, HBZones; plug-in component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

solveadjc = Honeybee_SolveAdjacencies(HBZones=flatten(mass2zone_2.HBZones), removeCurrentAdjc=False, findAdjc=toggle)  # -> readMe, HBZonesWADJ; plug-in component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

# ----
# Edit Building Zone Properties
glazingcreator = Honeybee_GlazingBasedOnRatio(HBObjects=solveadjc.HBZonesWADJ, glzRatio="0.3", breakUpWindow="10", runIt=Toggle(False))  # -> readMe, HBObjWGLZ; plug-in component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

solveadjc_2 = Honeybee_SolveAdjacencies(HBZones=flatten(mass2zone_2.HBZones), removeCurrentAdjc=False, findAdjc=toggle)  # -> readMe, HBZonesWADJ; plug-in component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
merge_5 = Merge(Data1=solveadjc_2.HBZonesWADJ, Data2=createepground)  # -> flatten(Result)
null_2 = NullItem(Item=merge_5)  # -> NullFlags, InvalidFlags, Description
bool_2 = Boolean(invert(null_2.NullFlags))

# ----
# Visualize Geometery
decomposebytype = Honeybee_DecomposeBasedOnType(HBZone=merge_5)  # -> walls, interiorWalls, airWalls, windows, interiorWindows, skylights, roofs, ceilings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; plug-in component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
preview = CustomPreview(Geometry=decomposebytype.walls, Shader=ColourSwatch(SwatchColor=RGB(135, 135, 135)))
preview_2 = CustomPreview(Geometry=[join.Breps, decomposebytype.groundFloors], Shader=ColourSwatch(SwatchColor=RGB(135, 88, 62)))
preview_3 = CustomPreview(Geometry=decomposebytype.roofs, Shader=ColourSwatch(SwatchColor=RGB(214, 214, 214)))
preview_4 = CustomPreview(Geometry=decomposebytype.floors, Shader=ColourSwatch(SwatchColor=RGB(74, 74, 74)))
preview_5 = CustomPreview(Shader=ColourSwatch(SwatchColor=RGB(135, 135, 135)))
preview_6 = CustomPreview(Geometry=box, Shader=ColourSwatch(SwatchColor=RGBA(73, 135, 69, 0)))
preview_7 = CustomPreview(Geometry=decomposebytype.windows, Shader=ColourSwatch(SwatchColor=RGBA(125, 227, 255, 90)))

cull_2 = CullPattern(List=merge_5, CullPattern=bool_2)

toggle_2 = BooleanToggle(True)
# Run Simulation
exporttoopenstudio = Honeybee_ExportToOpenStudio(
    epwWeatherFile=epw_stat.epwFile,
    analysisPeriod=analysisperiod.analysisPeriod,
    HBZones=flatten(merge_5),
    simulationOutputs=flatten(epoutput.simulationOutputs),
    writeOSM=toggle_2,
    runSimulation=toggle_2)  # -> readMe, osmFileAddress, idfFileAddress, resultFileAddress, eioFileAddress, rddFileAddress, htmlReport, studyFolder, model; plug-in component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

panel_2 = Panel(exporttoopenstudio.readMe)
panel_3 = Panel(exporttoopenstudio.osmFileAddress)

division = Division(A=number_slider, B=2)
brep_7 = Brep(move_3.Geometry)
toggle_3 = BooleanToggle(False)
readepsrfresult = Honeybee_ReadEPSurfaceResult(resultFileAddress=exporttoopenstudio.resultFileAddress)  # -> surfaceIndoorTemp, surfaceOutdoorTemp, surfaceEnergyFlow, opaqueEnergyFlow, glazEnergyFlow, windowTotalSolarEnergy, windowBeamEnergy, windowDiffEnergy, windowTransmissivity, otherSurfaceData; plug-in component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
indoorviewfactor = Honeybee_IndoorViewFactorCalculator(
    HBZones=flatten(merge_5),
    gridSize=division,
    distFromFloorOrSrf=flatten(brep_7),
    additionalShading=flatten(debrep.Faces),
    includeOutdoor=Toggle(True),
    buildMesh=toggle_3,
    runIt=toggle_3)  # -> readMe, port, viewFactorMesh, viewFactorInfo, port_2, testPts, viewMeshFaces, zoneWireFrame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; plug-in component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
# Build Outdoor Microclimate Map
outdoorcomfrecipe = Honeybee_OutdoorComfortAnalysisRecipe(
    viewFactorMesh=indoorviewfactor.viewFactorMesh,
    viewFactorInfo=indoorviewfactor.viewFactorInfo,
    epwFile=epw_stat.epwFile,
    srfOutdoorTemp=readepsrfresult.surfaceOutdoorTemp)  # -> comfRecipe; plug-in component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
concat = Concatenate(FragmentA="OutdoorComfTest-Ratio-", FragmentB=height_to_width_ratio)
microclimatemap = Honeybee_MicroclimateMapAnalysis(
    comfAnalysisRecipe=outdoorcomfrecipe,
    fileName=concat,
    analysisPeriodOrHOY=analysisperiod.analysisPeriod,
    writeResultFile=Toggle(False),
    parallel=Toggle(True),
    runIt=Toggle(False))  # -> readMe, port, radTempMtx, airTempMtx, operativeTempMtx, adaptComfMtx, degFromTargetMtx, port_2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; plug-in component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
visualizemicroclimate = Honeybee_VisualizeMicroclimateMap(
    comfResultsMtx=microclimatemap.operativeTempMtx,
    viewFactorMesh=flatten(indoorviewfactor.viewFactorMesh),
    analysisPeriod=analysisperiod_2.analysisPeriod)  # -> readMe, port, resultMesh, legend, legendBasePt, port_2, resultValues, resultColors; plug-in component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

preview_8 = CustomPreview(Geometry=indoorviewfactor.zoneWireFrame, Shader=ColourSwatch(SwatchColor=RGB(0, 0, 0)))
