# Grasshopper definition Urban_Weather_Generator_Workflow.gh (Grasshopper 0.9.76)
# plug-ins: Python Interpreter

brep = Brep([<brep referenced from the Rhino model> x8])
brep_2 = Brep([<brep referenced from the Rhino model> x93])
merge = Merge(Data1=brep_2, Data2=brep)
brep_3 = Brep([<brep referenced from the Rhino model> x2])

terrain = Brep(<brep referenced from the Rhino model>)
parkingtransitbuildings = Brep()
# Import Urban
# Geometry
commercialbuildings = Brep(brep_3)
residentialbuildings = Brep(merge)
grass = Brep([<brep referenced from the Rhino model> x20])
trees = Brep()

dragonfly = DFDragonfly()  # -> Vviiiiiiiiiizzz; plug-in component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
ladybug = Ladybug_Ladybug()  # -> Vviiiiiiiiiizzz; plug-in component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

# ----
# 1
toggle = BooleanToggle(True)

# ----
# Visualize Urban Area
swatch = ColourSwatch(SwatchColor=RGB(82, 82, 82))
preview = CustomPreview(Geometry=terrain, Shader=swatch)
preview_2 = CustomPreview(Geometry=grass, Shader=ColourSwatch(SwatchColor=RGB(118, 168, 133)))
preview_3 = CustomPreview(Geometry=trees, Shader=ColourSwatch(SwatchColor=RGB(40, 102, 58)))
preview_4 = CustomPreview(Geometry=commercialbuildings, Shader=ColourSwatch(SwatchColor=RGB(95, 100, 178)))
preview_5 = CustomPreview(Geometry=residentialbuildings, Shader=ColourSwatch(SwatchColor=RGB(235, 206, 94)))
preview_6 = CustomPreview(Geometry=parkingtransitbuildings, Shader=ColourSwatch(SwatchColor=RGB(143, 143, 143)))

bldg_program = Dragonfly_BldgProgram({"FullServiceRestaurant", "Hospital", "LargeHotel", "LargeOffice", "MediumOffice", "MidRiseApartment", "OutPatient", "PrimarySchool", "QuickServiceRestaurant", "SecondarySchool", "SmallHotel", "SmallOffice", "StandAloneRetail", "StripMall", "SuperMarket", "Warehouse"}, selected="MidRiseApartment")
bldg_age = Dragonfly_BldgAge({"Pre-1980's": "Pre1980s", "1980's-Present": "1980sPresent", "New Construction": "NewConstruction"}, selected="Pre-1980's")
bldg_program_2 = Dragonfly_BldgProgram({"FullServiceRestaurant", "Hospital", "LargeHotel", "LargeOffice", "MediumOffice", "MidRiseApartment", "OutPatient", "PrimarySchool", "QuickServiceRestaurant", "SecondarySchool", "SmallHotel", "SmallOffice", "StandAloneRetail", "StripMall", "SuperMarket", "Warehouse"}, selected="Warehouse")
bldg_age_2 = Dragonfly_BldgAge({"Pre-1980's": "Pre1980s", "1980's-Present": "1980sPresent", "New Construction": "NewConstruction"}, selected="1980's-Present")
# Define Building Typologies
bldg_program_3 = Dragonfly_BldgProgram({"FullServiceRestaurant", "Hospital", "LargeHotel", "LargeOffice", "MediumOffice", "MidRiseApartment", "OutPatient", "PrimarySchool", "QuickServiceRestaurant", "SecondarySchool", "SmallHotel", "SmallOffice", "StandAloneRetail", "StripMall", "SuperMarket", "Warehouse"}, selected="StandAloneRetail")
bldg_age_3 = Dragonfly_BldgAge({"Pre-1980's": "Pre1980s", "1980's-Present": "1980sPresent", "New Construction": "NewConstruction"}, selected="Pre-1980's")
bldgtypology = DFBuildingTypology(geo=commercialbuildings, program=bldg_program_3, age=bldg_age_3, flr_to_flr="4", run=toggle)  # -> read_me, typology, port, footprints, floors, facades; plug-in component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
bldgtypology_2 = DFBuildingTypology(geo=residentialbuildings, program=bldg_program, age=bldg_age, run=toggle)  # -> read_me, typology, port, footprints, floors, facades; plug-in component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
bldgtypology_3 = DFBuildingTypology(geo=parkingtransitbuildings, program=bldg_program_2, age=bldg_age_2, flr_to_flr="4", run=toggle)  # -> read_me, typology, port, footprints, floors, facades; plug-in component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

panel = Panel(bldgtypology.read_me)

# ----
# Define Urban Parameters
panel_2 = Panel("0.1")
vegpar = DFVegetationParameters(albedo="0.35", start_month=Slider(3, range=0..10), end_month=Slider(11, range=0..100))  # -> vegetation_par; plug-in component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
pavementpar = DFPavementParameters(albedo=panel_2)  # -> pavement_par; plug-in component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
trafficpar = DFTrafficParameters(sensible_heat="3")  # -> traffic_par; plug-in component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

# ---- group: Edit Envelope Parameters
typeenvelope = DFEditTypologyEnvelope(typology=[bldgtypology.typology, bldgtypology_2.typology], glz_ratio="0.3", shgc="0.4")  # -> read_me, typology; plug-in component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

# ----
# 2
toggle_2 = BooleanToggle(False)
dragonfly_building_typologies = Panel(typeenvelope.typology)

# ----
# Import Climate Data
weather_file = Panel("https://www.energyplus.net/weather-download/north_and_central_america_wmo_region_4/USA/FL/USA_FL_Miami.Intl.AP.722020_TMY3/all")
analysisperiod = Ladybug_AnalysisPeriod(fromMonth="7", toMonth="7")  # -> readMe, analysisPeriod; plug-in component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
epw_stat = Ladybug_OpenEPWAndSTATWeatherFiles(weatherFileURL=weather_file)  # -> epwFile, statFile; plug-in component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

importstat = Ladybug_ImportStat(statFile=epw_stat.statFile)  # -> readMe, ashraeClimateZone, koppenClimateZone, heatingDesignTemps, coolingDesignTemps, heatingDesignDay, coolingDesignDay, monthlyTauBeam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; plug-in component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
# Define the City
city = DFCity(
    typologies=flatten(typeenvelope.typology),
    terrain=flatten(terrain),
    trees=flatten(trees),
    grass=flatten(grass),
    climate_zone=importstat.ashraeClimateZone,
    traffic_par=trafficpar,
    vegetation_par=vegpar,
    pavement_par=pavementpar,
    run=toggle_2)  # -> read_me, port, city, port_2, tree_proj, grass_proj, terrain_proj; plug-in component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
dragonfly_city = Panel(city.city)
# 3
toggle_3 = BooleanToggle(False)

bndlayerpar = DFBoundaryLayerParameters()  # -> bnd_layer_par; plug-in component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
# Run the UWG
refepwpar = DFReferenceEPWParameters(veg_coverage="0.85")  # -> epw_site_par; plug-in component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
runuwg = DFRunUrbanWeatherGenerator(
    epw_file=epw_stat.epwFile,
    city=city.city,
    epw_site_par=refepwpar,
    bnd_layer_par=bndlayerpar,
    analysis_period=analysisperiod.analysisPeriod,
    write=toggle_3)  # -> read_me, port, urban_epw, port_2, uwg_object; plug-in component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

# ----
# Visualize the Results
importepw = Ladybug_ImportEpw(epwFile=epw_stat.epwFile)  # -> readMe, latitude, location, dryBulbTemperature, dewPointTemperature, relativeHumidity, windSpeed, windDirection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; plug-in component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
importepw_2 = Ladybug_ImportEpw(epwFile=runuwg.urban_epw)  # -> readMe, latitude, location, dryBulbTemperature, dewPointTemperature, relativeHumidity, windSpeed, windDirection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; plug-in component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
selectandaveragedata = Ladybug_AverageData(annualHourlyData=importepw_2.dryBulbTemperature, analysisPeriod=analysisperiod.analysisPeriod)  # -> readMe, selHourlyData, averagedDaily, averagedMonthly, avrMonthlyPerHour, avrMonthlyMinPerHour, avrMonthlyMaxPerHour; plug-in component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
selectandaveragedata_2 = Ladybug_AverageData(annualHourlyData=importepw.dryBulbTemperature, analysisPeriod=analysisperiod.analysisPeriod)  # -> readMe, selHourlyData, averagedDaily, averagedMonthly, avrMonthlyPerHour, avrMonthlyMinPerHour, avrMonthlyMaxPerHour; plug-in component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
legendpar = Ladybug_LegendParameters(lowBound="26", highBound="36", decimalPlaces="0")  # -> legendPar; plug-in component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
panel_3 = Panel("""Rural
Urban""")
pt = Point([Point(501.3960769, 275.3960491, 0), Point(501.3960769, -116.6456496, 0)])
_3dchart = Ladybug_3DChart(
    inputData=flatten([selectandaveragedata_2.selHourlyData, selectandaveragedata.selHourlyData]),
    basePoint="500,0,0",
    xScale="2",
    zScale="0",
    legendPar=legendpar)  # -> readMe, graphMesh, graphCurves, legend, legendBasePts, title, titleBasePts, dataPts, conditionalHOY; plug-in component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
tag = TextTag3D(Location=pt, Text=panel_3, Size="30", Justification=7)
